# Grasshopper definition Quick-Solar Radiation Analysis.gh (Grasshopper 1.0.8)
# plug-ins: Bifocals, LadybugGrasshopper

number_of_segments = Number(Slider(50, range=0..100))

# ----
# 2. Weather input and
# solar radiation study
boolean_toggle = BooleanToggle(True)
epwmap = LBEPWmap(epw_map=boolean_toggle)  # -> report; plug-in component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
analysisperiod = LBAnalysisPeriod(
    start_month=Slider(1, range=0..1),
    start_day=Slider(1, range=0..1),
    start_hour=Slider(8, range=8..8.001),
    end_month=Slider(12, range=0..12),
    end_day=Slider(5, range=0..5),
    end_hour=Slider(5, range=5..5.001))  # -> period, hoys, dates; plug-in component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
panel = Panel("https://energyplus-weather.s3.amazonaws.com/southwest_pacific_wmo_region_5/PHL/PHL_Manila.984290_IWEC/PHL_Manila.984290_IWEC.zip")
downloadepw = LBDownloadWeather(weather_URL=panel)  # -> epw_file, stat_file, ddy_file; plug-in component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
importepw = LBImportEPW(epw_file=downloadepw.epw_file)  # -> location, dry_bulb_temperature, dew_point_temperature, relative_humidity, wind_speed, wind_direction, direct_normal_rad, diffuse_horizontal_rad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; plug-in component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
skymatrix = LBCumulativeSkyMatrix(
    location=importepw.location,
    direct_rad=importepw.direct_normal_rad,
    diffuse_rad=importepw.diffuse_horizontal_rad,
    hoys=analysisperiod.hoys)  # -> report, sky_mtx; plug-in component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

skydome = LBSkyDome(sky_mtx=skymatrix.sky_mtx)  # -> out, mesh, compass, legend, title, patch_vecs, patch_values, mesh_values, vis_set; plug-in component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

# ----
# 1.Base Model parameters
multiple_curve_model = Brep(<brep referenced from the Rhino model>)
scurve_model = Brep(<brep referenced from the Rhino model>)
concave_model = Brep(<brep referenced from the Rhino model>)
convex_model = Brep(<brep referenced from the Rhino model>)

orthogonal_model = Brep(<brep referenced from the Rhino model>)

# ----
# GH Honeybee plug-in
# Versions
versions = HBCheckVersions()  # -> lbt_gh, python, radiance, openstudio, energyplus; plug-in component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
panel_2 = Panel(versions.openstudio)
panel_3 = Panel(versions.energyplus)
panel_4 = Panel(versions.python)
panel_5 = Panel(versions.radiance)
panel_6 = Panel(versions.lbt_gh)

twist = Slider(90, range=45..135)
brep_to_twist = Brep(scurve_model)

number_of_segments_2 = Number(number_of_segments)
toggle = BooleanToggle(False)
brep_to_twist_2 = Brep(brep_to_twist)
bbox = BoundingBox(Content=brep_to_twist_2, Plane=PlaneXY(0, 0, 0))  # -> Box, Box_2
debox = DeconstructBox(Box=bbox.Box)  # -> Plane, X, Y, Z
range = Range(Domain=debox.Z, Steps=expr("x-1", number_of_segments_2))
dedomain = DeconstructDomain(Domain=debox.Z)  # -> Start, End
pt = ConstructPoint(XCoordinate=0, YCoordinate=0, ZCoordinate=dedomain.Start)
pt_2 = ConstructPoint(XCoordinate=0, YCoordinate=0, ZCoordinate=dedomain.End)
remap = RemapNumbers(Value=range, Source=debox.Z, Target=Domain(0, 1))  # -> Mapped, Clipped
xy = XYPlane(Origin=pt)
xy_2 = XYPlane(Origin=pt_2)
shift = ShiftList(List=remap.Mapped, Shift=Slider(1, range=0..1), Wrap=toggle)
shift_2 = ShiftList(List=shift, Shift=Slider(-1, range=-2..0), Wrap=toggle)
scale_nu = ScaleNU(Geometry=bbox.Box, Plane=xy_2, ScaleX=1, ScaleY=1, ScaleZ=reverse(shift_2))  # -> simplify(graft(Geometry)), Transform
scale_nu_2 = ScaleNU(Geometry=bbox.Box, Plane=xy, ScaleX=1, ScaleY=1, ScaleZ=shift_2)  # -> simplify(graft(Geometry)), Transform
path_mapper = PathMapper(scale_nu_2.Geometry, source="{A}", target="{A+1}")
merge = Merge(Data1=scale_nu.Geometry, Data2=path_mapper)  # -> simplify(Result)
overall_bounding_box = Box(bbox.Box)
segment_heights = Number(range)
segments_boxes = Brep(merge)
base_plane = Plane(xy)

base_plane_2 = Plane(base_plane)
segment_heights_2 = Number(segment_heights)
overall_bounding_box_2 = Box(overall_bounding_box)
debrep = DeconstructBrep(Brep=overall_bounding_box_2)  # -> Faces, Edges, Vertices
pcen = PolygonCenter(Polyline=debrep.Faces)  # -> CenterV, CenterE, CenterA
pt_3 = ConstructPoint(XCoordinate=0, YCoordinate=0, ZCoordinate=segment_heights_2)
pdecon = Deconstruct(Point=pcen.CenterV)  # -> XComponent, YComponent, ZComponent
sort = SortList(Keys=pdecon.ZComponent, ValuesA=debrep.Faces, ValuesB=pcen.CenterV)  # -> Keys, ValuesA, ValuesB
xy_3 = XYPlane(Origin=pt_3)
item = ListItem(List=sort.ValuesA, Index=0, Wrap=True)
item_2 = ListItem(List=sort.ValuesB, Index=0, Wrap=True)
orient = Orient(Geometry=item, Source=base_plane_2, Target=xy_3)  # -> Geometry, Transform
pl_origin = PlaneOrigin(Base=base_plane_2, Origin=item_2)
rotation_plane = Plane(pl_origin)
twisted_planes = Brep(orient.Geometry)

number_slider = Slider(0, range=-1..0)
angle_start = Number(number_slider)
angle_end = Number(twist)

angle_end_2 = Number(angle_end)
twisted_planes_2 = Brep(twisted_planes)
angle_start_2 = Number(angle_start)
rotation_plane_2 = Plane(rotation_plane)
number_of_divisions = Number(number_of_segments)
dom = ConstructDomain(DomainStart=angle_start_2, DomainEnd=angle_end_2)
range_2 = Range(Domain=dom, Steps=expr("x-1", number_of_divisions))
panel_7 = Panel("""{0;0}
{0;+1}
{0;+2}
{0;+3}
{+1;0}
{+1;+1}
{+1;+2}
{+1;+3}""")
rotate = Rotate(Geometry=twisted_planes_2, Angle=degrees(range_2), Plane=rotation_plane_2)  # -> Geometry, Transform
debrep_2 = DeconstructBrep(Brep=rotate.Geometry)  # -> Faces, Edges, simplify(graft(Vertices))
relitem = RelativeItem(Tree=debrep_2.Vertices, Offset=panel_7, WrapPaths=False, WrapItems=False)  # -> ItemA, ItemB
split = SplitTree(Data=relitem.ItemB, Masks=flatten("{?;(0)}"))  # -> Positive, Negative
item_3 = ListItem(List=split.Positive, Index=0, Wrap=True)  # -> Item, Item1, Item2, Item3, Item4, Item5, Item6, Item7
tbox = TwistedBox(
    CornerA=item_3.Item,
    CornerB=item_3.Item1,
    CornerC=item_3.Item2,
    CornerD=item_3.Item3,
    CornerE=item_3.Item4,
    CornerF=item_3.Item5,
    CornerG=item_3.Item6,
    CornerH=item_3.Item7)
angles = Number(range_2)
twisted_boxes = TwistedBox(tbox)

overall_bounding_box_3 = Box(overall_bounding_box)
twisted_boxes_2 = TwistedBox(twisted_boxes)
segment_boxes = Brep(segments_boxes)
brep_to_twist_3 = Brep(brep_to_twist)
sdiff = SolidDifference(BrepsA=overall_bounding_box_3, BrepsB=segment_boxes)
sdiff_2 = SolidDifference(BrepsA=brep_to_twist_3, BrepsB=segment_boxes)
box_corners = BoxCorners(Box=sdiff)  # -> CornerA, CornerB, CornerC, CornerD, CornerE, CornerF, CornerG, CornerH
tbox_2 = TwistedBox(
    CornerA=box_corners.CornerA,
    CornerB=box_corners.CornerB,
    CornerC=box_corners.CornerC,
    CornerD=box_corners.CornerD,
    CornerE=box_corners.CornerE,
    CornerF=box_corners.CornerF,
    CornerG=box_corners.CornerG,
    CornerH=box_corners.CornerH)
morph = BoxMorph(Geometry=sdiff_2, Reference=tbox_2, Target=twisted_boxes_2)
twisted_segments = Brep(morph)

angles_2 = Number(angles)
abs = Absolute(Value=angles_2)
gradient = Gradient(
    LowerLimit=Slider(360, range=0..1000),
    UpperLimit=0,
    Parameter=abs,
    stops=[0: RGB(234, 38, 0), 0.25: RGB(234, 126, 0), 0.5: RGB(254, 244, 84), 0.75: RGB(173, 203, 249), 1: RGB(75, 107, 169)])
twisted_segments_2 = Brep(twisted_segments)
preview = CustomPreview(Geometry=twisted_segments_2, Shader=graft(gradient))

# ----
# 4. Genetic Algorithm
# by Galapagos
# 3. Solar Radiation Study
# UPCA PhDDE Dissertation
# Erwin B. Albis
# 1990-78059
# Case Study Models
# by Erwin B. Albis
# Version 1.0
number_slider_2 = Slider(1, range=0..1)
brep = Brep(<brep referenced from the Rhino model>)
data = Data(analysisperiod.dates)
colrange = LBColorRange(index=number_slider_2)  # -> colors; plug-in component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
legendpar = LBLegendParameters(min=Slider(1, range=0..1), max=Slider(1000, range=0..1600), colors=colrange)  # -> leg_par; plug-in component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
list_item = ListItem(List=data, Index=0, Wrap=True)  # -> Item1, Item
concatenate = Concatenate(FragmentA="Solar Radiation Analysis", FragmentB=list_item.Item, FragmentD=list_item.Item1)
point = Point(<point referenced from the Rhino model>)
lb_falsestarttoggle = LBFalseStartToggle(False)

galapagos = Galapagos(fitness=mass_addition, gene=[twist, rotation, number_slider])
rotation = Slider(124, range=0..360)

rotate_2 = Rotate(Geometry=twisted_segments_2, Angle=degrees(rotation), Plane=point)  # -> Geometry, Transform
incidentradiation = LBIncidentRadiation(
    sky_mtx=skymatrix.sky_mtx,
    geometry=flatten(rotate_2.Geometry),
    context=flatten(brep),
    grid_size=Slider(1, range=0..50),
    offset_dist=Slider(1, range=0..1.5),
    run=lb_falsestarttoggle)  # -> report, points, results, total, mesh, legend, title, int_mtx; plug-in component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
heatmap = LBSpatialHeatmap(
    values=incidentradiation.results,
    mesh=incidentradiation.mesh,
    legend_par=legendpar,
    legend_title="kWh/m2",
    global_title=concatenate)  # -> mesh, legend, title, colors, legend_par, vis_set; plug-in component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
panel_8 = Panel(incidentradiation.title)
solar_incident_radiation = Panel(incidentradiation.total)

mass_addition = MassAddition(Input=incidentradiation.results)  # -> Result, PartialResults
combined_flux_intensity = Panel(mass_addition.Result)
partial_results = Panel(mass_addition.PartialResults)
data_recorder = DataRecorder(combined_flux_intensity, DataLimit=-10, RecordData=True)
list_item_2 = ListItem(List=data_recorder, Index=Slider(100, range=0..100), Wrap=True)
