# Grasshopper definition TwistedGeometry.gh (Grasshopper 0.9.64)

# ---- group: User Inputs
# Created by: Danny Boyes
brep_to_twist = Brep(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)
number_of_segments = Number(Slider(50, range=0..100))
angle_start = Number(Slider(0, range=-360..360))
angle_end = Number(Slider(0, range=-360..360))

# ----
number_of_segments_2 = Number(number_of_segments)
brep_to_twist_2 = Brep(brep_to_twist)
bbox = BoundingBox(Content=brep_to_twist_2, Plane=PlaneXY(0, 0, 0))  # -> Box, Box_2
debox = DeconstructBox(Box=bbox.Box)  # -> Plane, X, Y, Z
range = Range(Domain=debox.Z, Steps=expr("N-1", number_of_segments_2))
dedomain = DeconstructDomain(Domain=debox.Z)  # -> Start, End
pt = ConstructPoint(XCoordinate=0, YCoordinate=0, ZCoordinate=dedomain.Start)
pt_2 = ConstructPoint(XCoordinate=0, YCoordinate=0, ZCoordinate=dedomain.End)
remap = RemapNumbers(Value=range, Source=debox.Z, Target=Domain(0, 1))  # -> Mapped, Clipped
xy = XYPlane(Origin=pt)
xy_2 = XYPlane(Origin=pt_2)
toggle = BooleanToggle(False)
shift = ShiftList(List=remap.Mapped, Shift=Slider(1, range=0..1), Wrap=toggle)
shift_2 = ShiftList(List=shift, Shift=Slider(-1, range=-2..0), Wrap=toggle)
scale_nu = ScaleNU(Geometry=bbox.Box, Plane=xy_2, ScaleX=1, ScaleY=1, ScaleZ=reverse(shift_2))  # -> simplify(graft(Geometry)), Transform
scale_nu_2 = ScaleNU(Geometry=bbox.Box, Plane=xy, ScaleX=1, ScaleY=1, ScaleZ=shift_2)  # -> simplify(graft(Geometry)), Transform
path_mapper = PathMapper(scale_nu_2.Geometry, source="{A}", target="{A+1}")
merge = Merge(Data1=scale_nu.Geometry, Data2=path_mapper)  # -> simplify(Result)
overall_bounding_box = Box(bbox.Box)
segment_heights = Number(range)
segments_boxes = Brep(merge)
base_plane = Plane(xy)

overall_bounding_box_2 = Box(overall_bounding_box)
base_plane_2 = Plane(base_plane)
segment_heights_2 = Number(segment_heights)
debrep = DeconstructBrep(Brep=overall_bounding_box_2)  # -> Faces, Edges, Vertices
pcen = PolygonCenter(Polyline=debrep.Faces)  # -> CenterV, CenterE, CenterA
pt_3 = ConstructPoint(XCoordinate=0, YCoordinate=0, ZCoordinate=segment_heights_2)
pdecon = Deconstruct(Point=pcen.CenterV)  # -> XComponent, YComponent, ZComponent
sort = SortList(Keys=pdecon.ZComponent, ValuesA=debrep.Faces, ValuesB=pcen.CenterV)  # -> Keys, ValuesA, ValuesB
xy_3 = XYPlane(Origin=pt_3)
item = ListItem(List=sort.ValuesA, Index=0, Wrap=True)
item_2 = ListItem(List=sort.ValuesB, Index=0, Wrap=True)
orient = Orient(Geometry=item, Source=base_plane_2, Target=xy_3)  # -> Geometry, Transform
pl_origin = PlaneOrigin(Base=base_plane_2, Origin=item_2)
rotation_plane = Plane(pl_origin)
twisted_planes = Brep(orient.Geometry)

twisted_planes_2 = Brep(twisted_planes)
angle_start_2 = Number(angle_start)
angle_end_2 = Number(angle_end)
number_of_divisions = Number(number_of_segments)
rotation_plane_2 = Plane(rotation_plane)
dom = ConstructDomain(DomainStart=angle_start_2, DomainEnd=angle_end_2)
range_2 = Range(Domain=dom, Steps=expr("N-1", number_of_divisions))
panel = Panel("""{0;0}
{0;+1}
{0;+2}
{0;+3}
{+1;0}
{+1;+1}
{+1;+2}
{+1;+3}""")
rotate = Rotate(Geometry=twisted_planes_2, Angle=degrees(range_2), Plane=rotation_plane_2)  # -> Geometry, Transform
debrep_2 = DeconstructBrep(Brep=rotate.Geometry)  # -> Faces, Edges, simplify(graft(Vertices))
relitem = RelativeItem(Tree=debrep_2.Vertices, Offset=panel, WrapPaths=False, WrapItems=False)  # -> ItemA, ItemB
split = SplitTree(Data=relitem.ItemB, Masks=flatten("{?;(0)}"))  # -> Positive, Negative
item_3 = ListItem(List=split.Positive, Index=0, Wrap=True)  # -> Item, Item1, Item2, Item3, Item4, Item5, Item6, Item7
tbox = TwistedBox(
    CornerA=item_3.Item,
    CornerB=item_3.Item1,
    CornerC=item_3.Item2,
    CornerD=item_3.Item3,
    CornerE=item_3.Item4,
    CornerF=item_3.Item5,
    CornerG=item_3.Item6,
    CornerH=item_3.Item7)
twisted_boxes = TwistedBox(tbox)
angles = Number(range_2)

overall_bounding_box_3 = Box(overall_bounding_box)
segment_boxes = Brep(segments_boxes)
twisted_boxes_2 = TwistedBox(twisted_boxes)
brep_to_twist_3 = Brep(brep_to_twist)
sdiff = SolidDifference(BrepsA=overall_bounding_box_3, BrepsB=segment_boxes)
sdiff_2 = SolidDifference(BrepsA=brep_to_twist_3, BrepsB=segment_boxes)
box_corners = BoxCorners(Box=sdiff)  # -> CornerA, CornerB, CornerC, CornerD, CornerE, CornerF, CornerG, CornerH
tbox_2 = TwistedBox(
    CornerA=box_corners.CornerA,
    CornerB=box_corners.CornerB,
    CornerC=box_corners.CornerC,
    CornerD=box_corners.CornerD,
    CornerE=box_corners.CornerE,
    CornerF=box_corners.CornerF,
    CornerG=box_corners.CornerG,
    CornerH=box_corners.CornerH)
morph = BoxMorph(Geometry=sdiff_2, Reference=tbox_2, Target=twisted_boxes_2)
twisted_segments = Brep(morph)

twisted_segments_2 = Brep(twisted_segments)
angles_2 = Number(angles)
abs = Absolute(Value=angles_2)
gradient = Gradient(
    LowerLimit=Slider(360, range=0..1000),
    UpperLimit=0,
    Parameter=abs,
    stops=[0: RGB(234, 38, 0), 0.25: RGB(234, 126, 0), 0.5: RGB(254, 244, 84), 0.75: RGB(173, 203, 249), 1: RGB(75, 107, 169)])
preview = CustomPreview(Geometry=twisted_segments_2, Shader=graft(gradient))
